# Grasshopper definition 250625_demo.gh (Grasshopper 1.0.8)
# plug-ins: Virtual Robot, Vizor

actor_sequence = Panel("""H
R
R""")

# ----
# Docker Connection
button = Button()
wsstart = WsConnection(Address="ws://127.0.0.1:9090", Reset=button)

# ----
# Define Robot
pt = Point(<point referenced from the Rhino model>)
xy = XYPlane(Origin=pt)
brep = Brep([<brep referenced from the Rhino model> x3])
scale = Scale(Geometry=brep, Center=Point(0, 0, 0), Factor=1000)  # -> Geometry, Transform
scale_2 = Scale(Geometry=xy, Center=Point(0, 0, 0), Factor=1000)  # -> Geometry, Transform
end_effector = DefineEndEffector(Geometry=scale.Geometry, TCPFrame=scale_2.Geometry, MountingFrame=PlaneXY(0, 0, 0))
xy_2 = XYPlane(Origin=Point(0, 0, 0))
ur10 = PredefinedUniversalRobotUR10(BaseFrame=xy_2, EndEffectorOptional=end_effector)
links = Panel("""base_link
base_link_inertia
shoulder_link
upper_arm_link
forearm_link
wrist_1_link
wrist_2_link
wrist_3_link
flange
tool0
gripper_base
gripper_fingers
tcp""")
robot = Robot(
    WebsocketObject=wsstart,
    Disable=Button(),
    RobotName="UR10",
    VirtualRobotModelNS=ur10,
    AxisToggles=[False, False, False],
    LinkNames=links)  # -> Output, RobotObject

# ----
# Define Marker
panel = Panel("marker1")
inputdevice = ARInputDevice(WebsocketObject=wsstart, Disable=Button(), DeviceName=panel)  # -> Output, ARDevice

# ----
# Define AR Clients
panel_2 = Panel("HOLO1")
hololens = Hololens(
    WebsocketObject=wsstart,
    Disable=Button(),
    DeviceName=panel_2,
    SkillConfiguration="{'robot-control': 1, 'screw': 1, 'pick-and-place': 1}")  # -> Output, ARDevice

# ----
# MCP Variables
actor_sequence_2 = Panel("""R
R
R""")
scene_remove = BooleanToggle(False)
start_task = BooleanToggle(False)
scene_update = BooleanToggle(False)
cluster_id_0_3 = Panel("3")

brep_2 = Brep([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])
env_update = BooleanToggle(True)
mesh = SceneMeshObject(
    TargetAnchor=robot.RobotObject,
    Meshes=brep_2,
    Names="env",
    Colours=ColourSwatch(SwatchColor=RGB(66, 92, 138)),
    DisplayRules="session")  # -> Output, MeshGeometryObjects
content = ConstructSceneContent(Name="env", Meshes=mesh.MeshGeometryObjects, LevelOfDetail=0)

# ----
# Geometry Input
brep_3 = Brep([<brep referenced from the Rhino model> x3])
brep_4 = Brep([<brep referenced from the Rhino model> x3])
num = Number(cluster_id_0_3)
brep_5 = Brep([<brep referenced from the Rhino model> x3])
brep_6 = Brep([<brep referenced from the Rhino model> x3])
cluster = Cluster_5(brep=brep_3)
cluster_2 = Cluster_4(brep=brep_4)
cluster_3 = Cluster_4(brep=brep_6)
cluster_4 = Cluster_5(brep=brep_5)
panel_3 = Panel("""01
02
03""")
filter = StreamFilter(Gate=num, Stream0=cluster_4, Stream1=cluster_3, Stream2=cluster, Stream3=cluster_2)
concat = Concatenate(FragmentA=num, FragmentB=panel_3)

# ---- group: all beams
brep_7 = Brep([brep_4, brep_5, brep_6, brep_3])

# ----
scene_model = XRSceneModel(
    GHControl=True,
    ARDevices=hololens.ARDevice,
    ContentObjects=flatten(content),
    TriggerSend=env_update,
    TriggerRemove=False,
    TimeDelay=100)

path_point = Slider(0.01, range=0.01..0.99)
beam_index = Slider(1, range=0..2)

# ---- group: beam
item = ListItem(List=filter, Index=beam_index, Wrap=True)
brep_8 = Brep(item)

# ---- group: robot
data = Data(robot.RobotObject)

# ----
item_2 = ListItem(List=concat, Index=0, Wrap=True)  # -> Item, Item1, Item2
item_3 = ListItem(List=filter, Index=0, Wrap=True)  # -> Item, Item1, Item2

# ---- group: robot
data_2 = Data(robot.RobotObject)

# ----
# MATERIAL PREP
merge = Merge(Data1=graft(cluster_4), Data2=graft(cluster_3), Data3=graft(cluster), Data4=graft(cluster_2))
merge_2 = Merge(Data1=flatten(cluster_4), Data2=flatten(cluster_3), Data3=flatten(cluster), Data4=flatten(cluster_2))
cluster_5 = Cluster_6(B=merge_2)  # -> pl_2, line_2
line = Line(cluster_5.line_2)
vec = Vector(line)
pt_2 = Point(<point referenced from the Rhino model>)
expression = Expression(x=vec, Expression="x/2")
xy_3 = XYPlane(Origin=pt_2)
lng = ListLength(List=merge_2)
move = Move(Geometry=cluster_5.pl_2, Motion=expression)  # -> Geometry, Transform
len = Length(Curve=line)  # -> flatten(Length)
arrlinear = LinearArray(Geometry=xy_3, Direction="{0.1,0,0}", Count=lng)  # -> Geometry, Transform
ma = MassAddition(Input=flatten(len))  # -> Result, PartialResults
tag = TextTag(Location=cluster_5.pl_2, Text=len)
panel_4 = Panel(ma.Result)

# ---- group: green A
brep_9 = Brep(item_3.Item)

# ---- group: red A
brep_10 = Brep(item_3.Item1)

# ---- group: blue A
brep_11 = Brep(item_3.Item2)

# ---- group: 3 x 1 = 3 tasks
# Scene Content
swatch = ColourSwatch(SwatchColor=RGB(181, 62, 53))
swatch_2 = ColourSwatch(SwatchColor=RGB(78, 169, 77))
swatch_3 = ColourSwatch(SwatchColor=RGB(23, 0, 212))
cluster_6 = Cluster(M=brep_9, txt=item_2.Item, col=swatch_2, data=data_2)  # -> M_2, content_2
cluster_7 = Cluster(M=brep_10, txt=item_2.Item1, col=swatch, data=data_2)  # -> M_2, content_2
cluster_8 = Cluster(M=brep_11, txt=item_2.Item2, col=swatch_3, data=data_2)  # -> M_2, content_2
human_task_name = Panel("""Beam 1 green
Beam 2 red
Beam 3 blue""")
human_task_name_2 = Panel("""Place and fix the green beam. 
Place and fix the red beam. 
Place and fix the blue beam. """)
merge_3 = Merge(Data1=cluster_6.content_2, Data2=cluster_7.content_2, Data3=cluster_8.content_2)
data_3 = Data(hololens.ARDevice)
merge_4 = Merge(Data1=swatch_2, Data2=swatch, Data3=swatch_3)
flip = FlipMatrix(Data=merge)
task = ConstructTaskObject(
    TaskNames=human_task_name,
    TargetDevices=data_3,
    SceneContents=merge_3,
    InstructionTexts=human_task_name_2,
    AssociatedSkill="null",
    EstimatedDuration=60)  # -> Output, TaskObject
preview = CustomPreview(Geometry=flip, Material=merge_4)

# ----
# Scene Update
scene_model_2 = XRSceneModel(
    GHControl=True,
    ARDevices=hololens.ARDevice,
    ContentObjects=flatten(merge_3),
    TriggerSend=scene_update,
    TriggerRemove=scene_remove,
    TimeDelay=100)
panel_5 = Panel(scene_model_2)

panel_6 = Panel("gripper open")

orient = Orient(Geometry=merge_2, Source=flatten(move.Geometry), Target=arrlinear.Geometry)  # -> Geometry, Transform
tag_2 = TextTag(Location=arrlinear.Geometry, Text=flatten(len))

py3 = Python3Script(seq=actor_sequence_2)  # -> out, pattern; inputs seq: list of String
# ---------- py3: Python ----------
"""Grasshopper Script"""
# a = "Hello Python 3 in Grasshopper!"
# print(a)

pattern = []

print(len(seq))

for i in range (3):
    if seq[i] == "H":
        pattern.append(0)
    elif seq[i] == "R":
        pattern += [1,1,1,1,1]
    else:
        print (seq[i])
        raise TypeError("Actor is neither human or robot.")
# ---------- end py3 ----------

# ----
# Pre-defined Frames
pt_3 = Point(<point referenced from the Rhino model>)
pt_4 = Point(Point(-0.5739246967, 0.03830774993, 0.5250377575))
pt_5 = Point(Point(0.09840871164, -0.4383395091, 0.5250377575))
xy_4 = XYPlane(Origin=pt_4)
xy_5 = XYPlane(Origin=pt_5)
xy_6 = XYPlane(Origin=pt_3)
rotate = Rotate(Geometry=xy_4, Angle=degrees(90), Plane=xy_4)  # -> Geometry, Transform
rotate_2 = Rotate(Geometry=xy_5, Angle=degrees(180), Plane=xy_5)  # -> Geometry, Transform
pflip = FlipPlane(Plane=[rotate.Geometry, rotate_2.Geometry], ReverseX=False, ReverseY=False, SwapAxes=True)

rotate_3 = Rotate(Geometry=xy_6, Angle=degrees(90), Plane=xy_6)  # -> Geometry, Transform

pflip_2 = FlipPlane(Plane=rotate_3.Geometry, ReverseX=False, ReverseY=False, SwapAxes=True)

# ---- group: home position
pln = Plane(pflip)

# ---- group: pick up position
pln_2 = Plane(pflip_2)

# ---- group: pickin
pln_3 = Plane(pln_2)

# ---- group: home
pln_4 = Plane(pflip)

# ----
# DEBUG
robot_trajectory = RobotTrajectory(pln_2=pln, pln=pln_3, brep=brep_8)  # -> R, R_2, R_3, plane

cartesian = BooleanToggle(True)
trajectory = RobotTrajectoryObject(TargetRobot=data, IsCartesian=cartesian, TCPFrames=robot_trajectory.R, TrajectoryWidth=0.01)  # -> Output, TrajectoryObject, TrajectoryMesh
trajectory_2 = RobotTrajectoryObject(TargetRobot=data, IsCartesian=cartesian, TCPFrames=robot_trajectory.R_2, TrajectoryWidth=0.01)  # -> Output, TrajectoryObject, TrajectoryMesh
trajectory_3 = RobotTrajectoryObject(TargetRobot=data, IsCartesian=cartesian, TCPFrames=robot_trajectory.R_3, TrajectoryWidth=0.01)  # -> Output, TrajectoryObject, TrajectoryMesh
panel_7 = Panel("""_pickup
_place
_home""")  # disabled
merge_5 = Merge(
    Data1=flatten(trajectory.TrajectoryObject),
    Data2=flatten(trajectory_2.TrajectoryObject),
    Data3=flatten(trajectory_3.TrajectoryObject))  # disabled
number_slider = Slider(0, range=0..10)  # disabled
concat_2 = Concatenate(FragmentA=beam_index, FragmentB=panel_7)  # disabled
task_2 = ConstructTaskObject(
    TaskNames=concat_2,
    TargetDevices=data,
    RobotTrajectory=trajectory.TrajectoryObject,
    AssociatedSkill="null",
    EstimatedDuration=60)  # -> Output, TaskObject; disabled
number_slider_2 = Slider(300, range=0..1000)  # disabled
toggle = BooleanToggle(False)  # disabled
item_4 = ListItem(List=task_2.TaskObject, Index=number_slider, Wrap=True)  # disabled
simulator = RobotSimulator(Robot=robot.RobotObject, RobotTask=item_4, StepInterval=number_slider_2, Start=toggle)  # -> Output, CurrentTCP, CurrentGeometry, ExternalAxis; disabled
# Task Debugging
panel_8 = Panel(simulator.CurrentTCP)  # disabled

# ---- group: single OR all frames
merge_6 = Merge(Data1=flatten(robot_trajectory.R), Data2=flatten(robot_trajectory.R_2), Data3=flatten(robot_trajectory.R_3))
item_5 = ListItem(List=robot_trajectory.R_2, Index=0, Wrap=True)

# ----
# Virtual Robot Debugging
scale_3 = Scale(Geometry=pln_4, Center=Point(0, 0, 0), Factor=1000)  # -> Geometry, Transform
iframe = InterpolateFrames(Frames=scale_3.Geometry, Length=path_point, Step="1", Reset=Toggle(True))  # -> Frame, Percent, CurrentIndex
robot_ik = RobotInverseKinematics(Robot=ur10, TargetTCPFrame=iframe.Frame, AxisToggles=[False, False, False], useColorPreview=True)  # -> PoseGeometry, AxisValues, AxisFrames
scale_4 = Scale(Geometry=iframe.Frame, Center=Point(0, 0, 0), Factor=0.001)  # -> Geometry, Transform
scale_5 = Scale(Geometry=robot_ik.PoseGeometry, Center=Point(0, 0, 0), Factor=0.001)  # -> Geometry, Transform
orient_2 = Orient(Geometry=brep_8, Source=robot_trajectory.plane, Target=scale_4.Geometry)  # -> Geometry, Transform
panel_9 = Panel(robot_ik.AxisValues)

# ---- group: 3 x 3 = 9 tasks
cluster_9 = Cluster_3(brep=brep_9, txt=item_2.Item, data=robot.RobotObject, home=pln, pickplane=pln_2, robot=ur10)
cluster_10 = Cluster_3(brep=brep_10, txt=item_2.Item1, data=robot.RobotObject, home=pln, pickplane=pln_2, robot=ur10)
cluster_11 = Cluster_3(brep=brep_11, txt=item_2.Item2, data=robot.RobotObject, home=pln, pickplane=pln_2, robot=ur10)
merge_7 = Merge(Data1=flatten(cluster_9), Data2=flatten(cluster_10), Data3=flatten(cluster_11))

# ----
item_6 = ListItem(List=cluster_9, Index=0, Wrap=True)  # -> Item1, Item
merge_8 = Merge(Data1=item_6.Item1, Data2=cluster_9)
weave = Weave(Pattern=py3.pattern, Stream0=task.TaskObject, Stream1=merge_7, NullGaps=False)

# ----
# Task Execution
taskctrl = TaskController(Start=start_task, HRCTasks=weave, GHControl=True)  # -> CurrentTask, ProcessLog
exec_mode = BooleanToggle(True)
start = BooleanToggle(True)
simulate = SimulateDevice(
    NetworkDevice=hololens.ARDevice,
    TriggerAcknowledge=Button(),
    TriggerReject=False,
    TriggerPing=False,
    TriggerHelp=False,
    TaskID=0)
simulate_2 = SimulateDevice(
    NetworkDevice=robot.RobotObject,
    TriggerSuccess=Button(),
    TriggerError=False,
    TriggerPause=False,
    TriggerStop=False,
    TaskID=0)
panel_10 = Panel(taskctrl.ProcessLog)
executor = RobotExecution(Robot=robot.RobotObject, RobotTask=taskctrl.CurrentTask, Start=start, Physical=exec_mode)
panel_11 = Panel(simulate)

# ==== cluster Cluster
txt = ClusterInput()
col = ClusterInput()
data = ClusterInput()
M = ClusterInput()
col_2 = Colour(col)
data_2 = Data(data)
txt_2 = Text(txt)
yz = YZPlane(Origin=Point(0, 0, 0))
concat = Concatenate(FragmentA="dynamic_", FragmentB=txt_2)
mesh = SceneMeshObject(TargetAnchor=data_2, Meshes=M, Names=concat, Colours=col_2, DisplayRules="session")  # -> Output, MeshGeometryObjects
# Create Content Object
text = SceneTextObject(TargetAnchor=data_2, Texts=txt_2, Planes=yz, Names=txt_2, Colours=col_2, Solid=False, DisplayRules="session")  # -> Output, TextObjects
split = TextSplit(Text=txt_2, Separators="_")
item = ListItem(List=split, Index=0, Wrap=True)  # -> Item, Item1
content = ConstructSceneContent(Name=item.Item1, Meshes=mesh.MeshGeometryObjects, Texts=text.TextObjects, LevelOfDetail=0)  # -> flatten(ContentObject)
content_2 = ClusterOutput(content)
M_2 = ClusterOutput(mesh.MeshGeometryObjects)

# ==== cluster RobotTrajectory
pln = ClusterInput()
brep = ClusterInput()
pln_2 = ClusterInput()

# ---- group: pickup point
pln_3 = Plane(pln)

# ---- group: beam
brep_2 = Brep(brep)

# ---- group: home
pln_4 = Plane(pln_2)

# ---- group: placement point
debrep = DeconstructBrep(Brep=brep_2)  # -> Faces, Edges, Vertices
area = Area(Geometry=debrep.Faces)  # -> Area, Centroid
pdecon = Deconstruct(Point=area.Centroid)  # -> XComponent, YComponent, ZComponent
sort = SortList(Keys=pdecon.ZComponent, ValuesA=debrep.Faces)  # -> Keys, ValuesA
item = ListItem(List=reverse(sort.ValuesA), Index=0, Wrap=True)
debrep_2 = DeconstructBrep(Brep=item)  # -> Faces, Edges, Vertices
area_2 = Area(Geometry=item)  # -> Area, Centroid
len = Length(Curve=debrep_2.Edges)
sort_2 = SortList(Keys=len, ValuesA=debrep_2.Edges)  # -> Keys, ValuesA
item_2 = ListItem(List=sort_2.ValuesA, Index=0, Wrap=True)  # -> Item, Item1, Item2
py3 = Python3Script(line=item_2.Item)  # -> out, oLine; inputs line: Line
# ---------- py3: Python ----------
"""Grasshopper Script"""

import Rhino.Geometry as rg


start = line.PointAt(0)
end = line.PointAt(1)

if start.Y > end.Y:
    a = start
    b = end
else:
    a = end
    b = start

oLine = rg.Line(a, b)
# ---------- end py3 ----------
py3_2 = Python3Script(line=item_2.Item2)  # -> out, oLine; inputs line: Line
# ---------- py3_2: Python ----------
"""Grasshopper Script"""

import Rhino.Geometry as rg


start = line.PointAt(0)
end = line.PointAt(1)

if start.X > end.X:
    a = start
    b = end
else:
    a = end
    b = start

oLine = rg.Line(a, b)
# ---------- end py3_2 ----------
pl = ConstructPlane(Origin=area_2.Centroid, XAxis=py3.oLine, YAxis=py3_2.oLine)

# ----
rotate = Rotate(Geometry=pl, Angle=degrees("-90"), Plane=pl)  # -> Geometry, Transform
Z = UnitZ(Factor="0.3")
move = Move(Geometry=pln_3, Motion=Z)  # -> Geometry, Transform
move_2 = Move(Geometry=rotate.Geometry, Motion=Z)  # -> Geometry, Transform
item_3 = ListItem(List=pln_4, Index=0, Wrap=True)
rev = ReverseList(List=pln_4)
plane = ClusterOutput(rotate.Geometry)
merge = Merge(Data1=flatten(item_3), Data2=flatten(move.Geometry), Data3=flatten(pln_3))
merge_2 = Merge(
    Data1=flatten(pln_3),
    Data2=flatten(move.Geometry),
    Data3=flatten(pln_4),
    Data4=flatten(move_2.Geometry),
    Data5=flatten(rotate.Geometry))
merge_3 = Merge(Data1=flatten(rotate.Geometry), Data2=flatten(move_2.Geometry), Data3=flatten(rev))
R = ClusterOutput(merge)
R_2 = ClusterOutput(merge_2)
R_3 = ClusterOutput(merge_3)

# ==== cluster Cluster_3
home = ClusterInput()
pickplane = ClusterInput()
brep = ClusterInput()
txt = ClusterInput()
data = ClusterInput()

brep_2 = Brep(brep)
txt_2 = Text(txt)
data_2 = Data(data)

robot_trajectory = RobotTrajectory_2(pln_2=home, pln=pickplane, brep=brep_2)  # -> R, R_2, R_3, G
cluster = Cluster_2(relay_2=data_2, relay=brep_2, relay_3=robot_trajectory.G, B=pickplane)  # -> M_2, M_4, M_3, M, M_5
cartesian = BooleanToggle(True)
trajectory = RobotTrajectoryObject(TargetRobot=data_2, IsCartesian=cartesian, TCPFrames=pickplane, TrajectoryWidth=0.01)  # -> Output, TrajectoryObject, TrajectoryMesh
trajectory_2 = RobotTrajectoryObject(TargetRobot=data_2, IsCartesian=cartesian, TCPFrames=robot_trajectory.R, TrajectoryWidth=0.01)  # -> Output, TrajectoryObject, TrajectoryMesh
trajectory_3 = RobotTrajectoryObject(TargetRobot=data_2, IsCartesian=cartesian, TCPFrames=robot_trajectory.R_2, TrajectoryWidth=0.01)  # -> Output, TrajectoryObject, TrajectoryMesh
trajectory_4 = RobotTrajectoryObject(TargetRobot=data_2, IsCartesian=cartesian, TCPFrames=robot_trajectory.G, TrajectoryWidth=0.01)  # -> Output, TrajectoryObject, TrajectoryMesh
trajectory_5 = RobotTrajectoryObject(TargetRobot=data_2, IsCartesian=cartesian, TCPFrames=robot_trajectory.R_3, TrajectoryWidth=0.01)  # -> Output, TrajectoryObject, TrajectoryMesh
content = ConstructSceneContent(Name="content object", Meshes=cluster.M_2, LevelOfDetail=0)
content_2 = ConstructSceneContent(Name="content object", Meshes=cluster.M_4, LevelOfDetail=0)
content_3 = ConstructSceneContent(Name="content object", Meshes=cluster.M_3, LevelOfDetail=0)
content_4 = ConstructSceneContent(Name="content object", Meshes=cluster.M, LevelOfDetail=0)
content_5 = ConstructSceneContent(Name="content object", Meshes=cluster.M_5, LevelOfDetail=0)
robot = ClusterInput()

# ----
# Virtual Robot Debugging
number_slider = Slider(0.21, range=0.01..0.99)  # disabled
merge = Merge(Data1=robot_trajectory.R, Data2=robot_trajectory.R_2, Data3=robot_trajectory.R_3)  # disabled
toggle = BooleanToggle(True)  # disabled
scale = Scale(Geometry=merge, Center=Point(0, 0, 0), Factor=1000)  # -> Geometry, Transform; disabled
panel = Panel("1")  # disabled
iframe = InterpolateFrames(Frames=scale.Geometry, Length=number_slider, Step=panel, Reset=toggle)  # -> Frame, Percent, CurrentIndex; disabled
robot_ik = RobotInverseKinematics(Robot=robot, TargetTCPFrame=iframe.Frame, AxisToggles=[False, False, False], useColorPreview=True)  # -> PoseGeometry, AxisValues, AxisFrames; disabled
scale_2 = Scale(Geometry=iframe.Frame, Center=Point(0, 0, 0), Factor=0.001)  # -> Geometry, Transform; disabled
scale_3 = Scale(Geometry=robot_ik.PoseGeometry, Center=Point(0, 0, 0), Factor=0.001)  # -> Geometry, Transform; disabled
orient = Orient(Geometry=brep_2, Source=robot_trajectory.G, Target=scale_2.Geometry)  # -> Geometry, Transform; disabled

bbox = BoundingBox(Content=brep_2, Plane=PlaneXY(0, 0, 0))  # -> Box, Box_2
panel_2 = Panel("""_pickup
_close-gripper
_place
_open-gripper
_home""")
merge_2 = Merge(
    Data1=flatten(trajectory_2.TrajectoryObject),
    Data2=flatten(trajectory.TrajectoryObject),
    Data3=flatten(trajectory_3.TrajectoryObject),
    Data4=flatten(trajectory_4.TrajectoryObject),
    Data5=flatten(trajectory_5.TrajectoryObject))
debox = DeconstructBox(Box=bbox.Box)  # -> Plane, X, Y, Z
merge_3 = Merge(
    Data1=flatten(content),
    Data2=flatten(content_2),
    Data3=flatten(content_3),
    Data4=flatten(content_4),
    Data5=flatten(content_5))
num = Number(debox.Z)
concat = Concatenate(FragmentA=txt_2, FragmentB=panel_2)
concat_2 = Concatenate(FragmentD=concat, FragmentC="_", FragmentA=num, FragmentB="m_beam")
task = ConstructTaskObject(
    TaskNames=concat_2,
    TargetDevices=data_2,
    SceneContents=merge_3,
    RobotTrajectory=merge_2,
    AssociatedSkill="null",
    EstimatedDuration=60)  # -> Output, TaskObject
task_2 = ClusterOutput(task.TaskObject)

# ==== cluster Cluster_4
brep = ClusterInput()
brep_2 = Brep(brep)
volume = Volume(Geometry=brep_2)  # -> Volume, Centroid
pdecon = Deconstruct(Point=volume.Centroid)  # -> XComponent, YComponent, ZComponent
sort = SortList(Keys=pdecon.XComponent, ValuesA=brep_2)  # -> Keys, ValuesA
item = ListItem(List=sort.ValuesA, Index=0, Wrap=True)  # -> Item, Item1, Item2
merge = Merge(Data1=item.Item1, Data2=item.Item2, Data3=item.Item)
R = ClusterOutput(merge)

# ==== cluster Cluster_5
brep = ClusterInput()
brep_2 = Brep(brep)
volume = Volume(Geometry=brep_2)  # -> Volume, Centroid
pdecon = Deconstruct(Point=volume.Centroid)  # -> XComponent, YComponent, ZComponent
sort = SortList(Keys=pdecon.XComponent, ValuesA=brep_2)  # -> Keys, ValuesA
item = ListItem(List=sort.ValuesA, Index=0, Wrap=True)  # -> Item, Item1, Item2
merge = Merge(Data1=item.Item, Data2=item.Item2, Data3=item.Item1)
R = ClusterOutput(merge)

# ==== cluster Cluster_6
B = ClusterInput()

# ---- group: placement point
debrep = DeconstructBrep(Brep=B)  # -> Faces, Edges, Vertices
area = Area(Geometry=debrep.Faces)  # -> Area, Centroid
pdecon = Deconstruct(Point=area.Centroid)  # -> XComponent, YComponent, ZComponent
sort = SortList(Keys=pdecon.ZComponent, ValuesA=debrep.Faces)  # -> Keys, ValuesA
item = ListItem(List=reverse(sort.ValuesA), Index=0, Wrap=True)
debrep_2 = DeconstructBrep(Brep=item)  # -> Faces, Edges, Vertices
area_2 = Area(Geometry=item)  # -> Area, Centroid
len = Length(Curve=debrep_2.Edges)
sort_2 = SortList(Keys=len, ValuesA=debrep_2.Edges)  # -> Keys, ValuesA
item_2 = ListItem(List=sort_2.ValuesA, Index=0, Wrap=True)  # -> Item, Item1, Item2
py3 = Python3Script(line=item_2.Item)  # -> out, oLine; inputs line: Line; same code as py3
py3_2 = Python3Script(line=item_2.Item2)  # -> out, oLine; inputs line: Line; same code as py3_2
pl = ConstructPlane(Origin=area_2.Centroid, XAxis=py3.oLine, YAxis=py3_2.oLine)
line = Line(item_2.Item2)

# ----
pl_2 = ClusterOutput(pl)
line_2 = ClusterOutput(line)

# ==== cluster Cluster_2
relay = ClusterInput()
B = ClusterInput()
relay_2 = ClusterInput()
relay_3 = ClusterInput()
swatch = ColourSwatch(SwatchColor=RGB(226, 235, 127))
list = ValueList({"session", "step", "persistent", "flange"}, selected="flange")
list_2 = ValueList({"session", "step", "persistent", "flange"}, selected="step")
list_3 = ValueList({"session", "step", "persistent", "flange"}, selected="step")
list_4 = ValueList({"session", "step", "persistent", "flange"}, selected="session")
orient = Orient(Geometry=relay, Source=relay_3, Target=B)  # -> Geometry, Transform
orient_2 = Orient(Geometry=relay, Source=relay_3, Target=B)  # -> Geometry, Transform
orient_3 = Orient(Geometry=relay, Source=relay_3, Target=PlaneXY(0, 0, 0))  # -> Geometry, Transform
list_5 = ValueList({"session", "step", "persistent", "flange"}, selected="session")
mesh = SceneMeshObject(TargetAnchor=relay_2, Meshes=relay, Names="open-grip-beam", Colours=swatch, DisplayRules=list_4)  # -> Output, MeshGeometryObjects
mesh_2 = SceneMeshObject(
    TargetAnchor=relay_2,
    Meshes=orient.Geometry,
    Names="pick-beam",
    Colours=ColourSwatch(SwatchColor=RGB(170, 240, 207)),
    DisplayRules=list_2)  # -> Output, MeshGeometryObjects
mesh_3 = SceneMeshObject(
    TargetAnchor=relay_2,
    Meshes=orient_3.Geometry,
    Names="ee-beam",
    Colours=ColourSwatch(SwatchColor=RGB(255, 117, 117)),
    DisplayRules=list)  # -> Output, MeshGeometryObjects
mesh_4 = SceneMeshObject(TargetAnchor=relay_2, Meshes=orient_2.Geometry, Names="close-grip-beam", Colours=swatch, DisplayRules=list_3)  # -> Output, MeshGeometryObjects
mesh_5 = SceneMeshObject(
    TargetAnchor=relay_2,
    Meshes=relay,
    Names="final-beam",
    Colours=ColourSwatch(SwatchColor=RGB(94, 219, 219)),
    DisplayRules=list_5)  # -> Output, MeshGeometryObjects
M = ClusterOutput(mesh.MeshGeometryObjects)
M_2 = ClusterOutput(mesh_2.MeshGeometryObjects)
M_3 = ClusterOutput(mesh_3.MeshGeometryObjects)
M_4 = ClusterOutput(mesh_4.MeshGeometryObjects)
M_5 = ClusterOutput(mesh_5.MeshGeometryObjects)

# ==== cluster RobotTrajectory_2
pln = ClusterInput()
brep = ClusterInput()
pln_2 = ClusterInput()

# ---- group: pickup point
pln_3 = Plane(pln)

# ---- group: beam
brep_2 = Brep(brep)

# ---- group: home
pln_4 = Plane(pln_2)

# ---- group: placement point
debrep = DeconstructBrep(Brep=brep_2)  # -> Faces, Edges, Vertices
area = Area(Geometry=debrep.Faces)  # -> Area, Centroid
pdecon = Deconstruct(Point=area.Centroid)  # -> XComponent, YComponent, ZComponent
sort = SortList(Keys=pdecon.ZComponent, ValuesA=debrep.Faces)  # -> Keys, ValuesA
item = ListItem(List=reverse(sort.ValuesA), Index=0, Wrap=True)
debrep_2 = DeconstructBrep(Brep=item)  # -> Faces, Edges, Vertices
area_2 = Area(Geometry=item)  # -> Area, Centroid
len = Length(Curve=debrep_2.Edges)
sort_2 = SortList(Keys=len, ValuesA=debrep_2.Edges)  # -> Keys, ValuesA
item_2 = ListItem(List=sort_2.ValuesA, Index=0, Wrap=True)  # -> Item, Item1, Item2
py3 = Python3Script(line=item_2.Item)  # -> out, oLine; inputs line: Line; same code as py3
py3_2 = Python3Script(line=item_2.Item2)  # -> out, oLine; inputs line: Line; same code as py3_2
pl = ConstructPlane(Origin=area_2.Centroid, XAxis=py3.oLine, YAxis=py3_2.oLine)

# ----
rotate = Rotate(Geometry=pl, Angle=degrees("-90"), Plane=pl)  # -> Geometry, Transform
Z = UnitZ(Factor="0.3")
G = ClusterOutput(rotate.Geometry)
move = Move(Geometry=pln_3, Motion=Z)  # -> Geometry, Transform
move_2 = Move(Geometry=rotate.Geometry, Motion=Z)  # -> Geometry, Transform
item_3 = ListItem(List=pln_4, Index=0, Wrap=True)
rev = ReverseList(List=pln_4)
merge = Merge(Data1=flatten(item_3), Data2=flatten(move.Geometry), Data3=flatten(pln_3))
merge_2 = Merge(
    Data1=flatten(pln_3),
    Data2=flatten(move.Geometry),
    Data3=flatten(pln_4),
    Data4=flatten(move_2.Geometry),
    Data5=flatten(rotate.Geometry))
merge_3 = Merge(Data1=flatten(rotate.Geometry), Data2=flatten(move_2.Geometry), Data3=flatten(rev))
R = ClusterOutput(merge)
R_2 = ClusterOutput(merge_2)
R_3 = ClusterOutput(merge_3)
